# Grasshopper definition John Whitney Matrix III hexagons.gh (Grasshopper 1.0.7)
# plug-ins: Human

position = Slider(1000, range=0..1000)
lineweight = Slider(0.15, range=0..1)
points = Slider(20, range=0..100)

number_slider = Slider(10, range=0..100)

center_box = CenterBox(Base=PlaneXY(0, 0, 0), X=number_slider, Y=number_slider, Z=Slider(47, range=0..100))
populate_3d = Populate3D(Region=center_box, Count=Slider(30, range=0..100), Seed=Slider(39, range=0..100))
nurbs_curve = NurbsCurve(Vertices=populate_3d, Degree=2, Periodic=True)  # -> Curve, Length, Domain
seam = Seam(Curve=nurbs_curve.Curve, Seam=position)
divide_curve = DivideCurve(Curve=seam, Count=points, Kinks=False)  # -> Points, Tangents, Parameters
polygon = Polygon(Plane=divide_curve.Points, Radius=3, Segments=6, FilletRadius=0)  # -> Polygon, Length
colour_picker = ColourPicker(PickedColour=RGB(212, 167, 157))
custom_preview_lineweights = CustomPreviewLineweights(Geometry=polygon.Polygon, Shader=colour_picker, Thickness=lineweight, Absolute=True)
