# Grasshopper definition John Whitney Matrix III.gh (Grasshopper 1.0.7)
# plug-ins: Human

lightweight = Slider(4, range=0..10)

position_of_points_to_animate = Slider(1000, range=0..1000)
number_of_points = Slider(16, range=0..100)
line_height = Slider(216, range=0..1000)
geometry = Geometry(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)

seam = Seam(Curve=geometry, Seam=position_of_points_to_animate)
divide_curve = DivideCurve(Curve=seam, Count=number_of_points, Kinks=False)  # -> Points, Tangents, Parameters
unit_z = UnitZ(Factor=line_height)
move = Move(Geometry=divide_curve.Points, Motion=unit_z)  # -> Geometry, Transform
line = Line(StartPoint=divide_curve.Points, EndPoint=move.Geometry)
colour_picker = ColourPicker(PickedColour=RGB(196, 176, 171))
custom_preview_lineweights = CustomPreviewLineweights(Geometry=line, Shader=colour_picker, Thickness=lightweight, Absolute=True)
