# Grasshopper definition VeraMolnerHommageADurer1990.gh (Grasshopper 1.0.7)
# plug-ins: Pufferfish, Human

# ---- group: CurveParams
curve_type = Slider(1, range=0..1)
series_count = Slider(60, range=0..100)
jitter_seed = Slider(0.3, range=0..1)

# ---- group: Spacing
number_slider = Slider(10, range=0..10)
number_slider_2 = Slider(6, range=0..10)
number_slider_3 = Slider(42, range=0..100)
number_slider_4 = Slider(10, range=0..10)
number_slider_5 = Slider(4, range=0..10)

# ----
origin = Point(Point(0, 0, 0))

rectangle = Rectangle(Plane=PlaneXY(0, 0, 0), XSize=number_slider, YSize=number_slider, Radius=0)  # -> Rectangle, Length
rectangular_array = RectangularArray(Geometry=origin, Cell=rectangle.Rectangle, XCount=number_slider_5, YCount=number_slider_5)  # -> Geometry, Transform
series = Series(Start=0, Step=1, Count=series_count)
jitter = Jitter(List=rectangular_array.Geometry, Jitter=jitter_seed, Seed=series)  # -> Values, Indices
rectangle_2 = Rectangle(Plane=PlaneXY(0, 0, 0), XSize=number_slider_3, YSize=number_slider_3, Radius=0)  # -> Rectangle, Length
interpolate = Interpolate(Vertices=jitter.Values, Degree=curve_type, Periodic=True, KnotStyle=1)  # -> Curve, Length, Domain
rectangular_array_2 = RectangularArray(Geometry=flatten(origin), Cell=rectangle_2.Rectangle, XCount=number_slider_4, YCount=number_slider_2)  # -> Geometry, Transform
move_to_point = MoveToPoint(Geometry=flatten(interpolate.Curve), PointA=origin, PointB=rectangular_array_2.Geometry)  # -> Moved, Vector, Transform

panel = Panel(jitter.Values)

# ---- group: Vis
colour_picker = ColourPicker(PickedColour=RGB(230, 168, 138))
lineweight = Slider(1.17, range=0..10)

# ----
custom_preview_lineweights = CustomPreviewLineweights(Geometry=move_to_point.Moved, Shader=colour_picker, Thickness=lineweight, Absolute=True)
