# Grasshopper definition VeraMolnerHommageADurer1990v2.gh (Grasshopper 1.0.7)
# plug-ins: Pufferfish, Human

# ---- group: CurveParams
points_in_cloud = Slider(16, range=0..100)
curve_type = Slider(1, range=0..1)
jitter_seed = Slider(1, range=0..1)
series_count = Slider(221, range=0..1000)

# ---- group: Spacing
number_slider = Slider(35, range=0..100)
number_slider_2 = Slider(38, range=0..100)
x_boxes = Slider(14, range=0..100)
y_boxes = Slider(16, range=0..100)
number_slider_3 = Slider(4, range=0..10)

# ----
origin = Point(Point(0, 0, 0))

# ---- group: Spacing
number_slider_4 = Slider(10, range=0..10)
number_slider_5 = Slider(6, range=0..10)
number_slider_6 = Slider(42, range=0..100)
number_slider_7 = Slider(10, range=0..10)
number_slider_8 = Slider(4, range=0..10)

# ---- group: CurveParams
curve_type_2 = Slider(1, range=0..1)
series_count_2 = Slider(60, range=0..100)
jitter_seed_2 = Slider(0.3, range=0..1)

# ----
origin_2 = Point(Point(0, 0, 0))
multiplication = Multiplication(A=x_boxes, B=y_boxes)

rectangle = Rectangle(Plane=PlaneXY(0, 0, 0), XSize=number_slider, YSize=number_slider, Radius=0)  # -> Rectangle, Length
series = Series(Start=0, Step=1, Count=multiplication)
populate_2d = Populate2D(Region=rectangle.Rectangle, Count=points_in_cloud, Seed=series)
rectangle_2 = Rectangle(Plane=PlaneXY(0, 0, 0), XSize=number_slider_2, YSize=number_slider_2, Radius=0)  # -> Rectangle, Length
interpolate = Interpolate(Vertices=populate_2d, Degree=curve_type, Periodic=True, KnotStyle=1)  # -> Curve, Length, Domain
rectangular_array = RectangularArray(Geometry=flatten(origin), Cell=rectangle_2.Rectangle, XCount=x_boxes, YCount=y_boxes)  # -> Geometry, Transform
move_to_point = MoveToPoint(Geometry=flatten(interpolate.Curve), PointA=origin, PointB=rectangular_array.Geometry)  # -> Moved, Vector, Transform

rectangle_3 = Rectangle(Plane=PlaneXY(0, 0, 0), XSize=number_slider_4, YSize=number_slider_4, Radius=0)  # -> Rectangle, Length
rectangular_array_2 = RectangularArray(Geometry=origin_2, Cell=rectangle_3.Rectangle, XCount=number_slider_8, YCount=number_slider_8)  # -> Geometry, Transform
series_2 = Series(Start=0, Step=1, Count=series_count_2)
jitter = Jitter(List=rectangular_array_2.Geometry, Jitter=jitter_seed_2, Seed=series_2)  # -> Values, Indices
rectangle_4 = Rectangle(Plane=PlaneXY(0, 0, 0), XSize=number_slider_6, YSize=number_slider_6, Radius=0)  # -> Rectangle, Length
interpolate_2 = Interpolate(Vertices=jitter.Values, Degree=curve_type_2, Periodic=True, KnotStyle=1)  # -> Curve, Length, Domain
rectangular_array_3 = RectangularArray(Geometry=flatten(origin_2), Cell=rectangle_4.Rectangle, XCount=number_slider_7, YCount=number_slider_5)  # -> Geometry, Transform
move_to_point_2 = MoveToPoint(Geometry=flatten(interpolate_2.Curve), PointA=origin_2, PointB=rectangular_array_3.Geometry)  # -> Moved, Vector, Transform

panel = Panel(jitter.Values)

# ---- group: Vis
lineweight = Slider(0.99, range=0..10)
colour_picker = ColourPicker(PickedColour=RGB(194, 122, 103))

lineweight_2 = Slider(1.17, range=0..10)
colour_picker_2 = ColourPicker(PickedColour=RGB(230, 168, 138))

# ----
custom_preview_lineweights = CustomPreviewLineweights(Geometry=move_to_point.Moved, Shader=colour_picker, Thickness=lineweight, Absolute=True)
custom_preview_lineweights_2 = CustomPreviewLineweights(Geometry=move_to_point_2.Moved, Shader=colour_picker_2, Thickness=lineweight_2, Absolute=True)
